# Grasshopper definition BIM Generation Test.gh (Grasshopper 1.0.7)
# plug-ins: Elements

number_slider = Slider(4000, range=0..100000)
number_slider_2 = Slider(6, range=0..100)
number_slider_3 = Slider(0, range=0..1)
number_slider_4 = Slider(300, range=0..10000)
unit_z = UnitZ(Factor=number_slider_4)
rectangle = Rectangle(Plane=PlaneXY(0, 0, 0), XSize=number_slider, YSize=number_slider, Radius=0)  # -> Rectangle, Length
unityslider = UnitySlider(num=Slider(0.393, range=0..1), init=Button())  # -> out, Value; inputs num: Double, init: Boolean
# ---------- unityslider: C# usings ----------
using Grasshopper.Kernel.Special;
using Grasshopper.GUI.Canvas;
# ---------- unityslider: C# ----------
    if(num != prevVal){
      prevVal = num;
      sliderVal = num;
    }

    var inputs = Component.Params.Input;
    var finput = inputs[0];
    if(finput.SourceCount > 0){
      var slicomp = finput.Sources[0];
      if(slicomp.GetType() == typeof(GH_NumberSlider)){
        var slider = (GH_NumberSlider) slicomp;
        double min = Convert.ToDouble(slider.Slider.Minimum);
        double max = Convert.ToDouble(slider.Slider.Maximum);
        double val = Convert.ToDouble(slider.Slider.Value);
        var name = slider.NickName;
        int decim = slider.Slider.DecimalPlaces;
        int type = (int) slider.Slider.Type;
        Print(forceUpdate.ToString());

        if(forceUpdate || min != prevMin || max != prevMax || name != prevName || decim != prevDecim || type != prevType || init){
          using(var args = new Rhino.Runtime.NamedParametersEventArgs()){
            Component.PingDocument -= OnPingDocument;
            Component.PingDocument += OnPingDocument;
            Component.ObjectChanged -= OnObjectChanged;
            Component.ObjectChanged += OnObjectChanged;
            Grasshopper.Instances.ActiveCanvas.DocumentChanged -= OnDocumentChanged;
            Grasshopper.Instances.ActiveCanvas.DocumentChanged += OnDocumentChanged;

            args.Set("id", Component.InstanceGuid.ToString());
            args.Set("name", name);
            args.Set("min", min);
            args.Set("max", max);
            args.Set("decimal", decim);
            args.Set("value", val);
            args.Set("type", type);
            Rhino.Runtime.HostUtils.ExecuteNamedCallback("FromGHClearUI", args);
            Rhino.Runtime.HostUtils.ExecuteNamedCallback("FromGHCreateSlider", args);

            Register(Component);
          }

          prevMin = min;
          prevMax = max;
          prevName = name;
          prevDecim = decim;
          prevType = type;
          forceUpdate = false;
        }
      }
    }


    Value = sliderVal;
# ---------- unityslider: C# additional code ----------
  double sliderVal = 0.0;
  double prevVal = 0.0;
  IGH_Component comp = null;

  double prevMin = double.PositiveInfinity;
  double prevMax = double.PositiveInfinity;
  string prevName = "";
  int prevDecim = -1;
  int prevType = -1;
  bool forceUpdate = false;

  void Register(IGH_Component component)
  {
    Rhino.Runtime.HostUtils.RegisterNamedCallback("ToGH_Slider_" + Component.InstanceGuid.ToString(), ToGrasshopper);

    comp = component;
  }

  void ToGrasshopper(object sender, Rhino.Runtime.NamedParametersEventArgs args)
  {
    double val;
    if (args.TryGetDouble("sliderValue", out val)){
      sliderVal = val;

      if(Component.Params.Input[0].SourceCount > 0){
        var c = Component.Params.Input[0].Sources[0];
        if(c.GetType() == typeof(Grasshopper.Kernel.Special.GH_NumberSlider)){
          var slider = (Grasshopper.Kernel.Special.GH_NumberSlider) c;
          slider.SetSliderValue(Convert.ToDecimal(sliderVal));
        }
      }
    }

    comp.ExpireSolution(true);
  }

  public void OnPingDocument(object sender, GH_PingDocumentEventArgs e){
    if(e.Document == null){
      using(var args = new Rhino.Runtime.NamedParametersEventArgs()){
        args.Set("id", comp.InstanceGuid.ToString());
        Rhino.Runtime.HostUtils.ExecuteNamedCallback("FromGHClearUI", args);
      }
    }
  }

  public void OnObjectChanged(object sender, GH_ObjectChangedEventArgs e){
    if(e.Type == GH_ObjectEventType.Enabled){
      if(comp.Locked){
        using(var args = new Rhino.Runtime.NamedParametersEventArgs()){
          forceUpdate = true;
          args.Set("id", comp.InstanceGuid.ToString());
          Rhino.Runtime.HostUtils.ExecuteNamedCallback("FromGHClearUI", args);
        }
      }
    }

    comp.ExpireSolution(true);
  }

  public void OnDocumentChanged(object sender, GH_CanvasDocumentChangedEventArgs e){
    using(var args = new Rhino.Runtime.NamedParametersEventArgs()){
      args.Set("id", comp.InstanceGuid.ToString());
      Rhino.Runtime.HostUtils.ExecuteNamedCallback("FromGHClearUI", args);

      forceUpdate = true;

      if(comp != null){
        comp.ExpireSolution(true);
      }
    }
  }
# ---------- end unityslider ----------
divide_surface = DivideSurface(Surface=rectangle.Rectangle, UCount=number_slider_2, VCount=number_slider_2)  # -> flatten(Points), Normals, Parameters
list_length = ListLength(List=divide_surface.Points)
random = Random(Range=list_length, Number=Slider(100, range=0..10000), Seed=Slider(203, range=0..10000))
list_item = ListItem(List=divide_surface.Points, Index=random, Wrap=True)  # -> graft(Item)
floors = Floors(Boundary=rectangle.Rectangle, Thickness=Slider(30, range=0..1000), Level=number_slider_3)
move = Move(Geometry=list_item, Motion=unit_z)  # -> Geometry, Transform
item_index = ItemIndex(List=flatten(list_item), Item=flatten(list_item))  # -> simplify(graft(Index))
cull_index = CullIndex(List=flatten(list_item), Indices=item_index, Wrap=True)
closest_point = ClosestPoint(Point=list_item, Cloud=cull_index)  # -> ClosestPoint, CPIndex, Distance
gradient = Gradient(LowerLimit=0, UpperLimit=1, Parameter=Slider(0.5, range=0..1), stops=[0.15: RGB(255, 130, 160), 0.85: RGB(220, 0, 40)])
line = Line(StartPoint=list_item, EndPoint=closest_point.ClosestPoint)
circle = Circle(Plane=PlaneXY(0, 0, 0), Radius=Slider(20, range=0..1000))
number_slider_5 = Slider(100, range=0..100)
line_2 = Line(StartPoint=list_item, EndPoint=move.Geometry)  # -> flatten(Line)
vector = Vector(line_2)
extrude = Extrude(Base=line, Direction=vector)
move_2 = Move(Geometry=line, Motion=vector)  # -> Geometry, Transform
column = Column(Section=circle, Path=line_2, StartLevel=number_slider_3, EndLevel=number_slider_4)
cloud_display = CloudDisplay(Points=divide_surface.Points, Colours=gradient, Size=Slider(250, range=0..1000), SpriteType=0)
curve = Curve([move_2.Geometry, line_2])
box_rectangle = BoxRectangle(Rectangle=flatten(extrude), Height=Domain(-15, 15))
brep = Brep(box_rectangle)
gradient_2 = Gradient(
    LowerLimit=0,
    UpperLimit=1,
    Parameter=0.5,
    stops=[0: RGB(234, 38, 0), 0.25: RGB(234, 126, 0), 0.5: RGB(254, 244, 84), 0.75: RGB(173, 203, 249), 1: RGB(75, 107, 169)])
unitymesh = UnityMesh(meshes=simplify([column, brep]), mats=simplify(gradient_2))  # -> outMesh, outMat; inputs meshes: tree of Mesh, mats: tree
# ---------- unitymesh: C# usings ----------
using System.Linq;
using System.Drawing;
using Grasshopper.GUI.Canvas;
# ---------- unitymesh: C# ----------
    if(comp == null){
      Component.PingDocument -= OnPingDocument;
      Component.PingDocument += OnPingDocument;
      Component.ObjectChanged -= OnObjectChanged;
      Component.ObjectChanged += OnObjectChanged;
      Grasshopper.Instances.ActiveCanvas.DocumentChanged -= OnDocumentChanged;
      Grasshopper.Instances.ActiveCanvas.DocumentChanged += OnDocumentChanged;

      comp = Component;
    }
    prevMeshes = meshes;

    DataTree<GH_Material> ghMats = new DataTree<GH_Material>();
    ClearAllMeshes(meshes);

    List <int> tempDataTreeCounts = new List<int>();
    for(int i = 0; i < meshes.BranchCount; i++){
      GH_Path path = meshes.Paths[i];
      tempDataTreeCounts.Add(meshes.Branches[i].Count);

      List<object> matList = mats.Branches[Math.Min(i, mats.BranchCount - 1)];
      for(int n = 0; n < meshes.Branches[i].Count; n++){
        Mesh mesh = meshes.Branches[i][n];
        object mat = matList[Math.Min(n, matList.Count - 1)];
        using(var args = new Rhino.Runtime.NamedParametersEventArgs())
        {
          Color color = Color.White;
          Color emission = Color.Black;
          Color specular = Color.DarkGray;
          double transparency = 0f;
          double shine = 50;


          if(mat != null && mat.GetType() == typeof(Rhino.Display.DisplayMaterial)){
            var material = (Rhino.Display.DisplayMaterial) mat;
            color = material.Diffuse;
            emission = material.Emission;
            transparency = material.Transparency;
            shine = material.Shine;
            specular = material.Specular;
          }else if(mat != null && mat.GetType() == typeof(System.Drawing.Color)){
            color = (System.Drawing.Color) mat;
            shine = 0.5;
          }

          args.Set("id", Component.InstanceGuid.ToString() + "-" + i.ToString() + "_" + n.ToString());
          args.Set("mesh", new Mesh[]{mesh});
          args.Set("diffuse", color);
          args.Set("emission", emission);
          args.Set("specular", specular);
          args.Set("transparency", transparency);
          args.Set("shine", shine);
          Rhino.Runtime.HostUtils.ExecuteNamedCallback("FromGHMesh", args);

          var displayMat = new Rhino.Display.DisplayMaterial(color);
          displayMat.Specular = specular;
          displayMat.Emission = emission;
          displayMat.Transparency = transparency;
          displayMat.Shine = shine;

          var ghmat = new GH_Material(displayMat);
          ghMats.Add(ghmat, path);
        }
      }
    }

    prevDataTreeCounts = tempDataTreeCounts;

    outMesh = meshes;
    outMat = ghMats;
# ---------- unitymesh: C# additional code ----------
  IGH_Component comp = null;
  DataTree<Mesh> prevMeshes = new DataTree<Mesh>();
  List<int> prevDataTreeCounts = new List<int>();

  public void OnPingDocument(object sender, GH_PingDocumentEventArgs e){
    if(e.Document == null){
      ClearAllMeshes(prevMeshes);
    }
  }

  public void OnObjectChanged(object sender, GH_ObjectChangedEventArgs e){
    if(e.Type == GH_ObjectEventType.Enabled){
      if(comp.Locked){
        ClearAllMeshes(prevMeshes);
      }
    }

    comp.ExpireSolution(true);
  }

  public void OnDocumentChanged(object sender, GH_CanvasDocumentChangedEventArgs e){
    ClearAllMeshes(prevMeshes);
    if(comp != null){
      comp.ExpireSolution(true);
    }
  }

  public void ClearAllMeshes(DataTree<Mesh> meshes){
    int branchCount = Math.Max(meshes.BranchCount, prevDataTreeCounts.Count);
    for(int i = 0; i < branchCount; i++){
      int meshCount = 0;
      int prevCount = 0;
      if(meshes.BranchCount > i){
        meshCount = meshes.Branches[i].Count;
      }
      if(prevDataTreeCounts.Count > i){
        prevCount = prevDataTreeCounts[i];
      }
      int itemCount = Math.Max(meshCount, prevCount);


      for(int n = 0; n < itemCount; n++){
        using(var args = new Rhino.Runtime.NamedParametersEventArgs()){
          args.Set("id", comp.InstanceGuid.ToString() + "-" + i.ToString() + "_" + n.ToString());
          Rhino.Runtime.HostUtils.ExecuteNamedCallback("FromGHClearMesh", args);
        }
      }
    }
  }
# ---------- end unitymesh ----------
